# Grasshopper definition random.gh (Grasshopper 0.9.76)

num = Number(1.5)
int = Integer(0)
int_2 = Integer(1)
addition = Addition(A=num, B=int_2)
c_script = CSharpScript()  # -> out, A, B
# ---------- c_script: C# ----------
    Random rd = new Random();
    int sample = 100;
    double c1 = 0.8;
    double c2 = 0.2;
    {
      var a = new List<Point3d>();
      for (int i = 0;i < sample;i++){
        a.Add(new Point3d(rd.NextDouble(), GetTriangleRand(c1, rd), 0));
      }
      A = a;
    }
    {
      var b = new List<Point3d>();
      for (int i = 0;i < sample;i++){
        //        b.Add(new Point3d(rd.NextDouble() + 2.0, GetNormalRand(0.5, 0.25, rd, a =>
        //          a < 0 ? a / 2.0 - 0.25 : a * 3.0 / 2.0 - 0.25
        //          ), 0));
        b.Add(new Point3d(rd.NextDouble() + 1.5, GetTriangleRand(c2, rd), 0));
      }
      B = b;
    }
# ---------- c_script: C# additional code ----------
  static double GetNormalRand(double ex,double sd,Random rand,Func<double,double> f= null, int count=12){
    if(f == null){
      f = (a) => a;
    }
    double xw = 0;
    for(int i = 0;i <= count;i++){
      xw += rand.NextDouble();
    }
    return sd * f(xw - count / 2.0) + ex;
  }

  static double GetTriangleRand(double center, Random rand){
    double r = rand.NextDouble();
    if(r < center){
      return Math.Sqrt(r / center) * center;
    }else{
      return 1 - Math.Sqrt((1 - r) / (1 - center)) * (1 - center);
    }
  }
# ---------- end c_script ----------
dom = ConstructDomain(DomainStart=int, DomainEnd=int_2)
dom_2 = ConstructDomain(DomainStart=num, DomainEnd=addition)
pt = Point(c_script.B)
rectangle = Rectangle(Plane=PlaneXY(0, 0, 0), XSize=dom, YSize=dom, Radius=0)  # -> Rectangle, Length
rectangle_2 = Rectangle(Plane=PlaneXY(0, 0, 0), XSize=dom_2, YSize=dom, Radius=0)  # -> Rectangle, Length
pt_2 = Point(c_script.A)
cir = Circle(Plane=[pt, pt_2], Radius=Slider(0.01, range=0..0.01))
rec = Rectangle([rectangle_2.Rectangle, rectangle.Rectangle])
circle = Circle(cir)
